# Grasshopper definition DLNT_Arch-Stairs-WIP.gh (Grasshopper 0.9.76)
# Copyright: CC-BY-NC

hauteur_totale = Panel("2780")
integer_division = IntegerDivision(A=hauteur_totale, B=Slider(172, range=0..1000))
division = Division(A=hauteur_totale, B=integer_division)
blondel_treshold = Slider(600, range=600..640)
hauteur_de_marche = Panel(division)
nombre_de_marche = Panel(integer_division)
loi_de_blondel = Panel("t-2*h")
eval = Evaluate(F=loi_de_blondel, h=division, t=blondel_treshold)
giron = Panel(eval)
nb_steps = Integer(nombre_de_marche)
depth = Number(giron)
height = Number(hauteur_de_marche)
pt = Point(<point referenced from the Rhino model>)
series = Series(Start=height, Step=height, Count=nb_steps)
neg = Negative(Value=series)
Z = UnitZ(Factor=neg)
series_2 = Series(Start=0, Step=depth, Count=nb_steps)
move = Move(Geometry=pt, Motion=Z)  # -> Geometry, Transform
X = UnitX(Factor=series_2)
series_3 = Series(Start=depth, Step=depth, Count=nb_steps)
X_2 = UnitX(Factor=series_3)
move_2 = Move(Geometry=move.Geometry, Motion=X)  # -> Geometry, Transform
move_3 = Move(Geometry=move.Geometry, Motion=X_2)  # -> Geometry, Transform
cull_last = CULL_last(L=move_3.Geometry)
merge = Merge(Data1=pt, Data2=cull_last)  # -> flatten(Result)
line = LineSDL(Direction=Vector(0, 0, 1), Length=1)
weave = Weave(Pattern=[0, 1], Stream0=merge, Stream1=move_2.Geometry, NullGaps=False)
pline = PolyLine(Vertices=weave, Closed=False)

# ==== cluster CULL_last
L = ClusterInput()
lng = ListLength(List=L)
subtraction = Subtraction(A=lng, B=1)
cull_i = CullIndex(List=L, Indices=subtraction, Wrap=True)
L_2 = ClusterOutput(cull_i)
