# Grasshopper definition DLNT_Arch-Stairs_Blondel.gh (Grasshopper 0.9.76)
# Copyright: CC-BY-NC

height = Slider(181, range=50..200)
blondel_treshold = Slider(600, range=600..640)
fonction = Panel("t-2*h")
eval = Evaluate(F=fonction, h=height, t=blondel_treshold)
giron = Panel(eval)
