# Grasshopper definition DLNT_Topography-ContourLines.gh (Grasshopper 0.9.76)
# Copyright: CC-BY-ND

# ----
# Base surface
srf = Surface(<surface referenced from the Rhino model>)

# ----
# Base point
pt = Point(<point referenced from the Rhino model>)

nb_plane = Slider(47, range=0..100)
z_spacing = Slider(3, range=0..10)
pt_2 = ConstructPoint(XCoordinate=0, YCoordinate=0, ZCoordinate=0)
brep = Brep(<brep referenced from the Rhino model>)
safe_z = Slider(10, range=0..10)
series = Series(Start=0, Step=z_spacing, Count=nb_plane)
pdecon = Deconstruct(Point=pt_2)  # -> XComponent, YComponent, ZComponent
bbox = BoundingBox(Content=brep, Plane=PlaneXY(0, 0, 0))  # -> Box, Box_2
subtraction = Subtraction(A=pdecon.XComponent, B=safe_z)
addition = Addition(A=pdecon.ZComponent, B=series)
debox = DeconstructBox(Box=bbox.Box)  # -> Plane, X, Y, Z
pt_3 = ConstructPoint(XCoordinate=subtraction, YCoordinate=pdecon.YComponent, ZCoordinate=addition)
xy = XYPlane(Origin=pt_3)  # -> simplify(Plane)
neg = Negative(Value=Slider(3, range=0..10))
altitudes = Panel("""0
3
6
9
12
15
18
21
24
27
30""")
Z = UnitZ(Factor=neg)
# Flat bodies
brep_2 = Brep(<brep referenced from the Rhino model>)  # disabled
# CUT
sec = BrepPlane(Brep=brep, Plane=graft(xy))  # -> Curves, Points
# curved body
brep_3 = Brep(<brep referenced from the Rhino model>)
altitudes_2 = Panel("""0
10
13
23
33
43
46
49
52
55
58
61
64""")
# Engrave
move = Move(Geometry=sec.Curves, Motion=Z)  # -> Geometry, Transform
ref_mat_thickness = Panel("""10
3
10
10
10
3
3
3
3
3
3
3""")
ref_mat_thickness_2 = Panel("""10
3
10
10
10
3
3
3
3
3
3
3""")
xy_2 = XYPlane(Origin=Point(0, 0, 0))  # disabled
pt_4 = ConstructPoint(XCoordinate=0, YCoordinate=0, ZCoordinate=altitudes_2)
pt_5 = ConstructPoint(XCoordinate=0, YCoordinate=0, ZCoordinate=altitudes)
smaller = SmallerThan(FirstNumber=graft(ref_mat_thickness), SecondNumber=7)  # -> SmallerThan, OrEqualTo
xy_3 = XYPlane(Origin=pt_4)  # -> simplify(Plane)
smaller_2 = SmallerThan(FirstNumber=graft(ref_mat_thickness_2), SecondNumber=7)  # -> SmallerThan, OrEqualTo
xy_4 = XYPlane(Origin=pt_5)  # -> simplify(Plane)
project = Project(Geometry=sec.Curves, Plane=xy_2)  # -> Geometry, Transform; disabled
preview = CustomPreview(Geometry=sec.Curves, Shader=ColourSwatch(SwatchColor=RGB(255, 0, 0)))
preview_2 = CustomPreview(Geometry=move.Geometry, Shader=ColourSwatch(SwatchColor=RGB(0, 98, 255)))

# ----
# All
crv = Curve(project.Geometry)  # disabled

sec_2 = BrepPlane(Brep=brep_2, Plane=graft(xy_3))  # -> Curves, Points
sec_3 = BrepPlane(Brep=brep_3, Plane=graft(xy_4))  # -> Curves, Points
panel = Panel("""true
false
false
false
false""")  # disabled
viewer = ParamViewer(crv)  # disabled
number_slider = Slider(3, range=0..10)  # disabled
dispatch = Dispatch(List=simplify(sec_2.Curves), DispatchPattern=simplify(smaller.SmallerThan))  # -> ListA, ListB
dispatch_2 = Dispatch(List=simplify(sec_3.Curves), DispatchPattern=simplify(smaller_2.SmallerThan))  # -> ListA, ListB; disabled
cull_first = CULL_first()
cull_first_2 = CULL_first()
shift = ShiftList(List=panel, Shift=number_slider, Wrap=True)  # disabled
clean = CleanTree(RemoveNulls=True, RemoveInvalid=True, RemoveEmpty=True, Tree=dispatch.ListA)
clean_2 = CleanTree(RemoveNulls=True, RemoveInvalid=True, RemoveEmpty=True, Tree=dispatch.ListB)
clean_3 = CleanTree(RemoveNulls=True, RemoveInvalid=True, RemoveEmpty=True, Tree=dispatch_2.ListA)
clean_4 = CleanTree(RemoveNulls=True, RemoveInvalid=True, RemoveEmpty=True, Tree=dispatch_2.ListB)
dispatch_3 = Dispatch(List=viewer, DispatchPattern=shift)  # -> ListA, ListB; disabled

# ----
# Mat. 10mm
crv_2 = Curve(clean_2)

# ----
# Mat. 3mm
crv_3 = Curve(clean)

# ----
# Mat. 10mm
crv_4 = Curve(clean_4)

# ----
# Mat. 3mm
crv_5 = Curve(clean_3)

# ----
# Main
branch = TreeBranch(Tree=crv, Path=dispatch_3.ListA, MaintainPaths=True)  # disabled

# ----
# Sub
branch_2 = TreeBranch(Tree=crv, Path=dispatch_3.ListB, MaintainPaths=True)  # disabled

swatch = ColourSwatch(SwatchColor=RGB(38, 38, 38))  # disabled
swatch_2 = ColourSwatch(SwatchColor=RGB(0, 0, 0))  # disabled
preview_3 = CustomPreview(Geometry=crv_3, Shader=ColourSwatch(SwatchColor=RGB(0, 98, 255)))
preview_4 = CustomPreview(Geometry=crv_5, Shader=ColourSwatch(SwatchColor=RGB(0, 98, 255)))
preview_5 = CustomPreview(Geometry=crv_2, Shader=ColourSwatch(SwatchColor=RGB(255, 0, 0)))
preview_6 = CustomPreview(Geometry=crv_4, Shader=ColourSwatch(SwatchColor=RGB(255, 0, 0)))
preview_7 = CustomPreview(Geometry=branch_2, Shader=swatch)  # disabled
preview_8 = CustomPreview(Geometry=branch, Shader=swatch_2)  # disabled

# ==== cluster CULL_first
L = ClusterInput()
cull_i = CullIndex(List=L, Indices=0, Wrap=True)
L_2 = ClusterOutput(cull_i)
