# Grasshopper definition DLNT_RebuildMesh-Loft_Isocurves.gh (Grasshopper 0.9.76)
# Copyright: CC-BY-ND

pt = Point([<point referenced from the Rhino model> x2332])
pdecon = Deconstruct(Point=pt)  # -> XComponent, YComponent, ZComponent
sort = SortList(Keys=pdecon.XComponent, ValuesA=pt)  # -> Keys, ValuesA
partition = PartitionList(List=sort.ValuesA, Size=Slider(53, range=0..100))  # -> simplify(Chunks)
branch = TreeBranch(Tree=partition, Path=Slider(4, range=0..10), MaintainPaths=True)
pdecon_2 = Deconstruct(Point=partition)  # -> XComponent, YComponent, ZComponent
sort_2 = SortList(Keys=pdecon_2.YComponent, ValuesA=partition)  # -> Keys, ValuesA
intcrv = Interpolate(Vertices=sort_2.ValuesA, Degree=3, Periodic=False, KnotStyle=1)  # -> Curve, Length, Domain
loft = Loft(
    Curves=flatten(intcrv.Curve),
    Options={Adjust=False, Closed=False, LoftEnds=0, LoftSimp=0, LoftType=0, Rebuild=10, Refit=0.01})
