# Grasshopper definition DLNT_SectionTool.gh (Grasshopper 0.9.76)
# Copyright: CC-BY-NC

# ---- group: Cutting plane
brep = Brep(<brep referenced from the Rhino model>)

# ----
brep_2 = Brep([<brep referenced from the Rhino model> x148])
mesh = Mesh([<mesh referenced from the Rhino model> x119])
mesh_2 = MeshBrep(
    Brep=brep,
    Settings={GridMaxCount=0, GridMinCount=16, JaggedSeams=False, MaxEdgeLength=0, MinEdgeLength=0.0001, MinTolerance=0, Refine=True, RefineAngle=0, RelativeTolerance=0.65, SimplePlanes=True, Tolerance=0})
bbx = BrepBrep(BrepA=brep, BrepB=brep_2)  # -> Curves, Points
mmx = MeshMesh(MeshA=mesh_2, MeshB=mesh, UseMeshMeshFast=True)
join = JoinCurves(Curves=flatten(bbx.Curves), Preserve=False)
join_2 = JoinCurves(Curves=flatten(mmx), Preserve=False)
