# Grasshopper definition DLNT_FAB-Emboitement_Tenon-Mortaise.gh (Grasshopper 0.9.75)

thickness_mm = Slider(30, range=1..250)

# ----
# Crv input
crv = Curve(<curve referenced from the Rhino model>)

bounds_dash = BooleanToggle(False)
dash_step_mm = Slider(6, range=1..12)

# ----
# Unit:
# Crv output
list = ValueList({"mm": 1, "cm": 10, "m": 1000}, selected="mm")

# ----
# Crv input
crv_2 = Curve(<curve referenced from the Rhino model>)

crv_3 = Curve()  # disabled

crv_4 = Curve(<curve referenced from the Rhino model>)
crv_5 = Curve(crv_2)

crv_6 = Curve(crv_4)

planar = Planar(Curve=crv_5)  # -> Planar, Plane, Deviation
explode = Explode(Curve=crv_5, Recursive=True)  # -> Segments, Vertices
item = ListItem(List=explode.Segments, Index=Slider(0, range=0..3), Wrap=True)
end = EndPoints(Curve=crv_6)  # -> Start, End

crv_7 = Curve(graft(item))

Z = UnitZ(Factor=1)
len = Length(Curve=crv_7)
len_2 = Length(Curve=crv_6)
move = Move(Geometry=end.Start, Motion=Z)  # -> Geometry, Transform
multiplication = Multiplication(A=len, B=list)
integer_division = IntegerDivision(A=multiplication, B=dash_step_mm)
panel = Panel(integer_division)

# ----
# Identify even number
panel_2 = Panel("2")
mod = Modulus(A=integer_division, B=panel_2)
smaller = SmallerThan(FirstNumber=mod, SecondNumber="0")  # -> SmallerThan, OrEqualTo

# ----
# If even
panel_3 = Panel("1")
addition = Addition(A=integer_division, B=panel_3)

weave = Weave(Pattern=smaller.OrEqualTo, Stream0=integer_division, Stream1=addition, NullGaps=False)
divide = DivideCurve(Curve=crv_7, Count=weave, Kinks=False)  # -> Points, Tangents, Parameters
shatter = Shatter(Curve=crv_7, Parameters=divide.Parameters)
panel_4 = Panel("""0
1""")
panel_5 = Panel("""1
0""")
weave_2 = Weave(Pattern=bounds_dash, Stream0=panel_4, Stream1=panel_5, NullGaps=False)
cull = CullPattern(List=shatter, CullPattern=weave_2)  # -> simplify(List)
cull_2 = CullPattern(List=shatter, CullPattern=reverse(weave_2))  # -> simplify(List)
offset = Offset(Curve=cull, Distance=1, Plane=planar.Plane, Corners=1)  # -> flatten(Curve)
lng = ListLength(List=offset)
lng_2 = ListLength(List=cull_2)
num = Number(thickness_mm)
neg = Negative(Value=num)
panel_6 = Panel(offset)
larger = LargerThan(FirstNumber=lng, SecondNumber=lng_2)  # -> LargerThan, OrEqualTo
smaller_2 = SmallerThan(FirstNumber=lng, SecondNumber=lng_2)  # -> SmallerThan, OrEqualTo
cull_last = CULL_last(L=offset)
cull_last_2 = CULL_last(L=cull_2)
weave_3 = Weave(Pattern=larger.OrEqualTo, Stream0=offset, Stream1=cull_last, NullGaps=False)
weave_4 = Weave(Pattern=smaller_2.OrEqualTo, Stream0=cull_2, Stream1=cull_last_2, NullGaps=False)
end_2 = EndPoints(Curve=weave_3)  # -> Start, End
end_3 = EndPoints(Curve=weave_4)  # -> Start, End
ln = Line(StartPoint=end_2.Start, EndPoint=end_3.End)
ln_2 = Line(StartPoint=end_3.Start, EndPoint=end_2.End)
lnpt = LinePt(Line=crv_6, Point=move.Geometry)
lnpt_2 = LinePt(Line=crv_6, Point=move.Geometry)

# ----
# Unit:
# Crv output
bounds_dash_2 = BooleanToggle(False)
dash_step_mm_2 = Slider(56, range=1..250)
list_2 = ValueList({"mm": 1, "cm": 0.1, "m": 0.001}, selected="mm")

multiplication_2 = Multiplication(A=dash_step_mm_2, B=list_2)
integer_division_2 = IntegerDivision(A=len_2, B=multiplication_2)
panel_7 = Panel(integer_division_2)

# ----
# Identify even number
panel_8 = Panel("2")
mod_2 = Modulus(A=integer_division_2, B=panel_8)
smaller_3 = SmallerThan(FirstNumber=mod_2, SecondNumber="0")  # -> SmallerThan, OrEqualTo

# ----
# If even
panel_9 = Panel("1")
addition_2 = Addition(A=integer_division_2, B=panel_9)

weave_5 = Weave(Pattern=smaller_3.OrEqualTo, Stream0=integer_division_2, Stream1=addition_2, NullGaps=False)
panel_10 = Panel(weave_5)
divide_2 = DivideCurve(Curve=crv_6, Count=weave_5, Kinks=False)  # -> Points, Tangents, Parameters
shatter_2 = Shatter(Curve=crv_6, Parameters=divide_2.Parameters)

panel_11 = Panel("""1
0""")
panel_12 = Panel("""0
1""")
cull_3 = CullPattern(List=shatter_2, CullPattern=panel_12)
cull_4 = CullPattern(List=shatter_2, CullPattern=panel_11)

weave_6 = Weave(Pattern=bounds_dash_2, Stream0=cull_3, Stream1=cull_4, NullGaps=False)

crv_8 = Curve(cull_3)
crv_9 = Curve(cull_4)
offset_2 = Offset(Curve=crv_9, Distance=neg, Plane=PlaneXY(0, 0, 0), Corners=1)  # -> flatten(Curve)
offset_3 = Offset(Curve=crv_8, Distance=num, Plane=PlaneXY(0, 0, 0), Corners=1)  # -> flatten(Curve)

end_4 = EndPoints(Curve=crv_8)  # -> Start, End
end_5 = EndPoints(Curve=crv_9)  # -> Start, End
end_6 = EndPoints(Curve=offset_2)  # -> Start, End
end_7 = EndPoints(Curve=offset_3)  # -> Start, End

crv_10 = Curve(weave_6)

crv_11 = Curve(crv_10)

pt = Point(end_7.End)
ln_3 = Line(StartPoint=end_6.End, EndPoint=end_5.End)
ln_4 = Line(StartPoint=end_5.Start, EndPoint=end_6.Start)
ln_5 = Line(StartPoint=end_4.Start, EndPoint=end_7.Start)
ln_6 = Line(StartPoint=end_7.End, EndPoint=end_4.End)
join = JoinCurves(Curves=flatten([ln_4, offset_2, ln_3, crv_8]), Preserve=False)
join_2 = JoinCurves(Curves=flatten([crv_9, ln_5, offset_3, ln_6]), Preserve=False)
mirror = Mirror(Geometry=join, Plane=lnpt)  # -> Geometry, Transform
mirror_2 = Mirror(Geometry=join_2, Plane=lnpt_2)  # -> Geometry, Transform

crv_12 = Curve(join_2)
crv_13 = Curve(mirror.Geometry)
crv_14 = Curve(mirror_2.Geometry)
crv_15 = Curve(join)

# ==== cluster CULL_last
L = ClusterInput()
lng = ListLength(List=L)
subtraction = Subtraction(A=lng, B=1)
cull_i = CullIndex(List=L, Indices=subtraction, Wrap=True)
L_2 = ClusterOutput(cull_i)
