# Grasshopper definition DLNT_FAB-Emboitement_clips.gh (Grasshopper 0.9.76)

crv = Curve(<curve referenced from the Rhino model>)

neg = Negative(Value=Slider(2.047, range=0..3))
crv_2 = Curve(<curve referenced from the Rhino model>)
offset = Offset(Curve=crv, Distance=neg, Plane=PlaneXY(0, 0, 0), Corners=1)
crv_3 = Curve(<curve referenced from the Rhino model>)
ccx = CurveCurve(CurveA=offset, CurveB=crv_2)  # -> Points, ParamsA, ParamsB
len = Length(Curve=crv_3)
shatter = Shatter(Curve=offset, Parameters=[ccx.ParamsA, ccx.ParamsB])
panel = Panel(len)
item = ListItem(List=shatter, Index=0, Wrap=True)  # -> Item, Item1, Item2, Item3, Item4
join = JoinCurves(Curves=item.Item1, Preserve=False)
len_2 = Length(Curve=join)
panel_2 = Panel(len_2)

bounds_dash = BooleanToggle(False)
bounds_dash_2 = BooleanToggle(True)
dash_step_mm = Slider(7, range=1..12)
material_thickness_mm = Slider(0.3, range=0.1..2)
tolerance_mm = Slider(0.2, range=0..3)

material_thickness_mm_2 = Slider(4, range=1..12)
tolerance_in_depth_mm = Slider(0, range=0..3)
tolerance_mm_2 = Slider(0.1, range=0..1)

# ----
# Dents / emboitements
crv_4 = Curve(crv_3)

material_thickness_mm_3 = Slider(1.3, range=1..12)
clip_depth_mm = Slider(0.5, range=0..3)
offset_thickness_mm = Slider(2.5, range=1..12)
tolerance_in_depth_mm_2 = Slider(0.1, range=0..1)
tolerance_mm_3 = Slider(0.1, range=0..1)

# ----
# Unit:
list = ValueList({"mm": 1, "cm": 10, "m": 1000}, selected="mm")

# ----
# Female
addition = Addition(A=material_thickness_mm, B=tolerance_mm)
cluster = Cluster(crv=crv_4, P=bounds_dash, B=list, B_2=dash_step_mm)
division = Division(A=addition, B=list)
crv_5 = Curve(cluster)
division_2 = Division(A=division, B=2)
neg_2 = Negative(Value=division_2)
offset_2 = Offset(Curve=crv_5, Distance=division_2, Plane=PlaneXY(0, 0, 0), Corners=1)
offset_3 = Offset(Curve=crv_5, Distance=neg_2, Plane=PlaneXY(0, 0, 0), Corners=1)
end = EndPoints(Curve=offset_2)  # -> Start, End
end_2 = EndPoints(Curve=offset_3)  # -> Start, End
ln = Line(StartPoint=end.Start, EndPoint=end_2.Start)
ln_2 = Line(StartPoint=end.End, EndPoint=end_2.End)
merge = Merge(Data1=ln, Data2=offset_3, Data3=ln_2, Data4=offset_2)  # -> simplify(Result)
join_2 = JoinCurves(Curves=merge, Preserve=False)

division_3 = Division(A=material_thickness_mm_3, B=list)
division_4 = Division(A=tolerance_mm_3, B=list)

# ----
# Male clipped
crv_6 = Curve(cluster)
division_5 = Division(A=offset_thickness_mm, B=list)
division_6 = Division(A=clip_depth_mm, B=list)
number_slider = Slider(0.3, range=0..1)  # disabled
offset_4 = Offset(Curve=crv_6, Distance=division_3, Plane=PlaneXY(0, 0, 0), Corners=1)  # -> flatten(Curve)
end_3 = EndPoints(Curve=offset_4)  # -> Start, End
end_4 = EndPoints(Curve=crv_6)  # -> Start, End
end_5 = EndPoints(Curve=offset_2)  # -> Start, End; disabled
X = UnitX(Factor=1)  # disabled
offset_5 = Offset(Curve=crv_4, Distance=number_slider, Plane=PlaneXY(0, 0, 0), Corners=1)  # disabled
offset_6 = Offset(Curve=crv_6, Distance=division_5, Plane=PlaneXY(0, 0, 0), Corners=1)  # -> flatten(Curve)
ln_3 = Line(StartPoint=end_4.Start, EndPoint=end_3.Start)
ln_4 = Line(StartPoint=end_4.End, EndPoint=end_3.End)
end_6 = EndPoints(Curve=offset_5)  # -> Start, End; disabled
line = LineSDL(Start=flatten([end_5.Start, end_5.End]), Direction=X, Length=100)  # disabled
curvepoint = PointOnCurve(offset_6, parameter=0.5)
end_7 = EndPoints(Curve=ln_3)  # -> Start, End
ln_5 = Line(StartPoint=end_6.End, EndPoint=end_6.Start)  # disabled
clx = CurveLine(Curve=offset_5, Line=line)  # -> flatten(Points), flatten(Params), Count; disabled
vec2pt = Vector2Pt(PointA=end_7.Start, PointB=end_7.End, Unitize=False)  # -> Vector, Length
vec2pt_2 = Vector2Pt(PointA=end_4.Start, PointB=end_3.Start, Unitize=False)  # -> Vector, Length
vec2pt_3 = Vector2Pt(PointA=end_4.End, PointB=end_3.End, Unitize=False)  # -> Vector, Length
join_3 = JoinCurves(Curves=[offset_5, ln_5], Preserve=False)  # disabled
cullpt = CullDuplicates(Points=clx.Points, Tolerance=0.1, CullMode=3)  # -> Points, Indices, Valence; disabled
Z = UnitZ(Factor=1)
boundary = BoundarySurfaces(Edges=join_3)  # disabled
xprod = CrossProduct(VectorA=vec2pt.Vector, VectorB=Z, Unitize=False)  # -> Vector, Length
crv_cp = CurveClosestPoint(Point=cullpt.Points, Curve=offset_5)  # -> Point, Parameter, Distance; disabled
blx = BrepLine(Brep=boundary, Line=line, LimitToFirst=False)  # -> simplify(Curves), Points; disabled
bcx = BrepCurve(Brep=boundary, Curve=line)  # -> simplify(Curves), Points; disabled
line_2 = LineSDL(Start=end_7.End, Direction=xprod.Vector, Length=division_6)
shatter_2 = Shatter(Curve=offset_5, Parameters=crv_cp.Parameter)  # disabled
panel_3 = Panel("""true
false""")  # disabled
end_8 = EndPoints(Curve=line_2)  # -> Start, End
cull = CullPattern(List=shatter_2, CullPattern=invert(panel_3))  # disabled
line_3 = LineSDL(Start=end_8.End, Direction=vec2pt_2.Vector, Length=division_6)
join_4 = JoinCurves(Curves=flatten([bcx.Curves, cull]), Preserve=False)  # disabled
end_9 = EndPoints(Curve=line_3)  # -> Start, End
pt = Point(end_9.End)

# ---- group: Avec crant
merge_2 = Merge(Data2=line_2, Data3=line_3)

# ---- group: Diagonale
ln_6 = Line(StartPoint=end_4.Start, EndPoint=pt)

# ----
ln_7 = Line(StartPoint=end_9.End, EndPoint=curvepoint)
merge_3 = Merge(Data1=merge_2, Data2=ln_7)  # -> flatten(Result)
Z_2 = UnitZ(Factor=1)
curvepoint_2 = PointOnCurve(crv_6, parameter=0.5)
move = Move(Geometry=curvepoint, Motion=Z_2)  # -> Geometry, Transform
join_5 = JoinCurves(Curves=merge_3, Preserve=False)
pl_3pt = Plane3Pt(PointA=curvepoint, PointB=curvepoint_2, PointC=move.Geometry)
mirror = Mirror(Geometry=join_5, Plane=pl_3pt)  # -> Geometry, Transform
flip = FlipCurve(Curve=mirror.Geometry)  # -> Curve, Flag
cluster_2 = Cluster(crv=crv_4, P=bounds_dash_2, B=list, B_2=dash_step_mm)
join_6 = JoinCurves(Curves=flatten([merge_3, mirror.Geometry]), Preserve=False)
end_10 = EndPoints(Curve=cluster_2)  # -> Start, End
end_11 = EndPoints(Curve=join_6)  # -> Start, End
cull_first = CULL_first(L=end_10.Start)
cull_last = CULL_last(L=end_10.End)
cull_first_2 = CULL_first(L=end_11.End)
ln_8 = Line(StartPoint=cull_last, EndPoint=end_11.Start)
ln_9 = Line(StartPoint=end_11.End, EndPoint=cull_first)
merge_4 = Merge(Data1=flatten(cluster_2), Data2=flatten(ln_8), Data3=join_6, Data4=ln_9)
join_7 = JoinCurves(Curves=flatten(merge_4), Preserve=False)

# ----
# Male
subtraction = Subtraction(A=material_thickness_mm_2, B=tolerance_in_depth_mm)
crv_7 = Curve(cluster)
end_12 = EndPoints(Curve=crv_7)  # -> Start, End
end_13 = EndPoints(Curve=crv_4)  # -> Start, End
end_14 = EndPoints(Curve=crv_4)  # -> Start, End

division_7 = Division(A=subtraction, B=list)
division_8 = Division(A=tolerance_mm_2, B=list)

offset_7 = Offset(Curve=crv_7, Distance=division_7, Plane=PlaneXY(0, 0, 0), Corners=1)  # -> flatten(Curve)
end_15 = EndPoints(Curve=offset_7)  # -> Start, End
ln_10 = Line(StartPoint=end_12.Start, EndPoint=end_15.Start)
ln_11 = Line(StartPoint=end_12.End, EndPoint=end_15.End)
merge_5 = Merge(Data1=ln_10, Data2=offset_7, Data3=ln_11)  # -> flatten(Result)
join_8 = JoinCurves(Curves=merge_5, Preserve=False)
neg_3 = Negative(Value=division_8)
offset_8 = Offset(Curve=join_8, Distance=neg_3, Plane=PlaneXY(0, 0, 0), Corners=1)  # -> flatten(Curve)
end_16 = EndPoints(Curve=offset_8)  # -> Start, End
lng = ListLength(List=offset_8)
subtraction_2 = Subtraction(A=lng, B=1)
item_2 = ListItem(List=flatten(offset_8), Index=0, Wrap=True)
lng_2 = ListLength(List=end_16.End)
subtraction_3 = Subtraction(A=lng_2, B=1)
item_3 = ListItem(List=flatten(offset_8), Index=subtraction_2, Wrap=True)
end_17 = EndPoints(Curve=item_2)  # -> Start, End
cull_i = CullIndex(List=end_16.End, Indices=flatten(subtraction_3), Wrap=True)
cull_i_2 = CullIndex(List=end_16.Start, Indices=flatten("0"), Wrap=True)
end_18 = EndPoints(Curve=item_3)  # -> Start, End
ln_12 = Line(StartPoint=end_13.Start, EndPoint=end_17.Start)
ln_13 = Line(StartPoint=cull_i, EndPoint=cull_i_2)
ln_14 = Line(StartPoint=end_18.End, EndPoint=end_14.End)
merge_6 = Merge(Data1=ln_12, Data2=offset_8, Data3=ln_13, Data4=ln_14)  # -> flatten(Result)
join_9 = JoinCurves(Curves=merge_6, Preserve=False)

# ==== cluster Cluster
crv = ClusterInput()

crv_2 = Curve(graft(crv))

B = ClusterInput()
end = EndPoints(Curve=crv_2)  # -> Start, End
len = Length(Curve=crv_2)
B_2 = ClusterInput()
multiplication = Multiplication(A=len, B=B)
integer_division = IntegerDivision(A=multiplication, B=B_2)
panel = Panel(integer_division)

# ----
# Identify even number
panel_2 = Panel("2")
mod = Modulus(A=integer_division, B=panel_2)
smaller = SmallerThan(FirstNumber=mod, SecondNumber="0")  # -> SmallerThan, OrEqualTo

# ----
# If even
panel_3 = Panel("1")
addition = Addition(A=integer_division, B=panel_3)

weave = Weave(Pattern=smaller.OrEqualTo, Stream0=integer_division, Stream1=addition, NullGaps=False)
divide = DivideCurve(Curve=crv_2, Count=weave, Kinks=False)  # -> Points, Tangents, Parameters
shatter = Shatter(Curve=crv_2, Parameters=divide.Parameters)

panel_4 = Panel("""1
0""")
panel_5 = Panel("""0
1""")
cull = CullPattern(List=shatter, CullPattern=panel_5)
cull_2 = CullPattern(List=shatter, CullPattern=panel_4)

P = ClusterInput()
weave_2 = Weave(Pattern=P, Stream0=cull, Stream1=cull_2, NullGaps=False)
crv_3 = Curve(weave_2)
crv_4 = ClusterOutput(crv_3)

# ==== cluster CULL_first
L = ClusterInput()
cull_i = CullIndex(List=L, Indices=0, Wrap=True)
L_2 = ClusterOutput(cull_i)

# ==== cluster CULL_last
L = ClusterInput()
lng = ListLength(List=L)
subtraction = Subtraction(A=lng, B=1)
cull_i = CullIndex(List=L, Indices=subtraction, Wrap=True)
L_2 = ClusterOutput(cull_i)
