# Grasshopper definition DLNT_FAB-Encoches.gh (Grasshopper 0.9.75)

# ----
# Unit:
list = ValueList({"mm": 1, "cm": 10, "m": 1000}, selected="mm")

# ----
# Crv input
crv = Curve(<curve referenced from the Rhino model>)

bounds_dash = BooleanToggle(False)

# ----
# Unit:
list_2 = ValueList({"mm": 1, "cm": 10, "m": 1000}, selected="mm")

dash_step_mm = Slider(6, range=1..12)

# ----
# Crv input
crv_2 = Curve(<curve referenced from the Rhino model>)

addition = Addition(A=dash_step_mm, B=Slider(0, range=0..1))
number_slider = Slider(0.1, range=0..1)
cluster = Cluster(crv=crv_2, P=bounds_dash, B=list_2, B_2=addition)
number_slider_2 = Slider(0.5, range=0..1)
ext = ExtendCurve(Curve=cluster, Type=0, Start=number_slider, End=number_slider)

crv_3 = Curve(graft(crv))

xz = XZPlane(Origin=Point(0, 0, 0))
crv_4 = Curve(ext)
neg = Negative(Value=Slider(5, range=0..10))
offset = Offset(Curve=crv_4, Distance=neg, Plane=xz, Corners=1)
end = EndPoints(Curve=crv_3)  # -> Start, End
len = Length(Curve=crv_3)
multiplication = Multiplication(A=len, B=list)
end_2 = EndPoints(Curve=simplify(offset))  # -> Start, End
end_3 = EndPoints(Curve=graft(crv_4))  # -> Start, End
ln = Line(StartPoint=end_3.Start, EndPoint=end_2.Start)
ln_2 = Line(StartPoint=end_2.End, EndPoint=end_3.End)
merge = Merge(Data1=crv_4, Data2=ln_2, Data3=offset, Data4=ln)  # -> flatten(Result)
join = JoinCurves(Curves=merge, Preserve=False)

# ----
# Crv output
bounds_dash_2 = BooleanToggle(False)
dash_step_mm_2 = Slider(6, range=1..12)

integer_division = IntegerDivision(A=multiplication, B=dash_step_mm_2)
panel = Panel(integer_division)

# ----
# Identify even number
panel_2 = Panel("2")
mod = Modulus(A=integer_division, B=panel_2)
smaller = SmallerThan(FirstNumber=mod, SecondNumber="0")  # -> SmallerThan, OrEqualTo

# ----
# If even
panel_3 = Panel("1")
addition_2 = Addition(A=integer_division, B=panel_3)

weave = Weave(Pattern=smaller.OrEqualTo, Stream0=integer_division, Stream1=addition_2, NullGaps=False)
divide = DivideCurve(Curve=crv_3, Count=weave, Kinks=False)  # -> Points, Tangents, Parameters
shatter = Shatter(Curve=crv_3, Parameters=divide.Parameters)

panel_4 = Panel("""1
0""")
panel_5 = Panel("""0
1""")
cull = CullPattern(List=shatter, CullPattern=panel_5)
cull_2 = CullPattern(List=shatter, CullPattern=panel_4)

weave_2 = Weave(Pattern=bounds_dash_2, Stream0=cull, Stream1=cull_2, NullGaps=False)
crv_5 = Curve(weave_2)

crv_6 = Curve(crv_5)

# ==== cluster Cluster
crv = ClusterInput()

crv_2 = Curve(graft(crv))

B = ClusterInput()
end = EndPoints(Curve=crv_2)  # -> Start, End
len = Length(Curve=crv_2)
B_2 = ClusterInput()
multiplication = Multiplication(A=len, B=B)
integer_division = IntegerDivision(A=multiplication, B=B_2)
panel = Panel(integer_division)

# ----
# Identify even number
panel_2 = Panel("2")
mod = Modulus(A=integer_division, B=panel_2)
smaller = SmallerThan(FirstNumber=mod, SecondNumber="0")  # -> SmallerThan, OrEqualTo

# ----
# If even
panel_3 = Panel("1")
addition = Addition(A=integer_division, B=panel_3)

weave = Weave(Pattern=smaller.OrEqualTo, Stream0=integer_division, Stream1=addition, NullGaps=False)
divide = DivideCurve(Curve=crv_2, Count=weave, Kinks=False)  # -> Points, Tangents, Parameters
shatter = Shatter(Curve=crv_2, Parameters=divide.Parameters)

panel_4 = Panel("""1
0""")
panel_5 = Panel("""0
1""")
cull = CullPattern(List=shatter, CullPattern=panel_5)
cull_2 = CullPattern(List=shatter, CullPattern=panel_4)

P = ClusterInput()
weave_2 = Weave(Pattern=P, Stream0=cull, Stream1=cull_2, NullGaps=False)
crv_3 = Curve(weave_2)
crv_4 = ClusterOutput(crv_3)
