# Grasshopper definition DLNT_FAB-Languettes-WIP.gh (Grasshopper 0.9.75)
# Copyright: CC

crv = Curve(<curve referenced from the Rhino model>)
explode = Explode(Curve=crv, Recursive=True)  # -> Segments, Vertices
number_slider = Slider(7, range=5..50)
neg = Negative(Value=Slider(3, range=1..15))
ext = ExtendCurve(Curve=explode.Segments, Type=0, Start=neg, End=neg)
offset = Offset(Curve=ext, Distance=number_slider, Plane=PlaneXY(0, 0, 0), Corners=1)  # -> simplify(Curve)
neg_2 = Negative(Value=number_slider)
ext_2 = ExtendCurve(Curve=offset, Type=0, Start=neg_2, End=neg_2)
end = EndPoints(Curve=ext)  # -> Start, End
end_2 = EndPoints(Curve=ext_2)  # -> Start, End
ln = Line(StartPoint=graft(end.Start), EndPoint=end_2.Start)
ln_2 = Line(StartPoint=graft(end.End), EndPoint=end_2.End)
merge = Merge(Data1=flatten(ln), Data2=flatten(ln_2), Data3=flatten(ext_2))

# ---- group: CUT
join = JoinCurves(Curves=merge, Preserve=False)
