# Grasshopper definition DLNT_FAB-Ramps4DiamondVBit_add.gh (Grasshopper 0.9.76)
# Copyright: CC-BY-NC
# plug-ins: RhinoNestGrasshopper

crv = Curve([<curve referenced from the Rhino model> x20])
number_slider = Slider(15.6, range=0..100)
area = Area(Geometry=crv)  # -> Area, Centroid
xz = XZPlane(Origin=area.Centroid)
offset = Offset(Curve=crv, Distance=number_slider, Plane=xz, Corners=1)
rno = RhinoNestOffsetInOut(Curves=crv, OutDistance=1, InDistance=number_slider)  # -> Result, O, I
crv_2 = Curve(rno.I)
explode = Explode(Curve=crv_2, Recursive=True)  # -> Segments, Vertices
explode_2 = Explode(Curve=crv, Recursive=True)  # -> Segments, Vertices
item = ListItem(List=explode.Vertices, Index=0, Wrap=True)  # -> Item, Item1, Item2, Item3, Item4, Item5, Item6, Item7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
item_2 = ListItem(List=explode_2.Vertices, Index=0, Wrap=True)  # -> Item, Item1, Item2, Item3
pt = Point(item.Item2)
pt_2 = Point(item.Item5)
pt_3 = Point(item_2.Item1)
pt_4 = Point(item.Item8)
pt_5 = Point(item_2.Item3)
pt_6 = Point(item_2.Item)
pt_7 = Point(item.Item11)
pt_8 = Point(item_2.Item2)
ln = Line(StartPoint=pt_5, EndPoint=pt_4)
ln_2 = Line(StartPoint=pt_8, EndPoint=pt_2)
ln_3 = Line(StartPoint=pt_3, EndPoint=pt)
ln_4 = Line(StartPoint=pt_6, EndPoint=pt_7)
merge = Merge(Data1=ln_3, Data2=ln, Data3=ln_4, Data4=ln_2)
