# Grasshopper definition DLNT_FAB-Smart-Filet.gh (Grasshopper 0.9.72)

diam_mm = Slider(6, range=0..20)
list = ValueList({"mm": 1, "cm": 0.1, "m": .001}, selected="cm")
crv = Curve([<curve referenced from the Rhino model> x2])
explode = Explode(Curve=crv, Recursive=True)  # -> Segments, Vertices
multiplication = Multiplication(A=list, B=diam_mm)

coef = Slider(1.5, range=1..3)
division = Division(A=multiplication, B=2)
multiplication_2 = Multiplication(A=division, B=coef)

end = EndPoints(Curve=explode.Segments)  # -> Start, End
area = Area(Geometry=crv)  # -> Area, Centroid
Z = UnitZ(Factor=area.Centroid)
vec2pt = Vector2Pt(PointA=end.Start, PointB=end.End, Unitize=True)  # -> Vector, Length
xy = XYPlane(Origin=end.End)
xprod = CrossProduct(VectorA=vec2pt.Vector, VectorB=Z, Unitize=True)  # -> Vector, Length
shift = ShiftList(List=vec2pt.Vector, Shift=1, Wrap=True)
vdis = VectorDisplay(Anchor=end.Start, Vector=xprod.Vector)
vdis_2 = VectorDisplay(Anchor=end.Start, Vector=vec2pt.Vector)
pl = ConstructPlane(Origin=end.End, XAxis=vec2pt.Vector, YAxis=xprod.Vector)
angle = Angle(VectorA=vec2pt.Vector, VectorB=shift, Plane=pl)  # -> Angle, Reflex
larger = LargerThan(FirstNumber=angle.Angle, SecondNumber="Pi")  # -> LargerThan, OrEqualTo
smaller = SmallerThan(FirstNumber=angle.Angle, SecondNumber="Pi")  # -> SmallerThan, OrEqualTo
shift_2 = ShiftList(List=explode.Segments, Shift=1, Wrap=True)
panel = Panel(xprod.Vector)
weave = Weave(Pattern=Toggle(True), Stream0=larger.OrEqualTo, Stream1=smaller.OrEqualTo, NullGaps=False)
cull = CullPattern(List=explode.Segments, CullPattern=weave)
cull_2 = CullPattern(List=shift_2, CullPattern=weave)
end_2 = EndPoints(Curve=cull)  # -> Start, End
end_3 = EndPoints(Curve=cull_2)  # -> Start, End
panel_2 = Panel(angle.Angle)
# Dir edge
vec2pt_2 = Vector2Pt(PointA=end_2.Start, PointB=end_2.End, Unitize=False)  # -> Vector, Length
vec2pt_3 = Vector2Pt(PointA=end_3.Start, PointB=end_3.End, Unitize=False)  # -> Vector, Length
pt = Point(end_2.End)
amp = Amplitude(Vector=vec2pt_3.Vector, Amplitude=multiplication_2)
amp_2 = Amplitude(Vector=vec2pt_2.Vector, Amplitude=multiplication_2)

move = Move(Geometry=pt, Motion=amp)  # -> Geometry, Transform
circle = CircleCNR(Center=move.Geometry, Normal=Vector(0, 0, 1), Radius=multiplication_2)
rdiff = RegionDifference(CurvesA=graft(crv), CurvesB=circle)

crv_2 = Curve(rdiff)
runion = RegionUnion(Curves=flatten([crv, circle]))
crv_3 = Curve(runion)
