# Grasshopper definition DLNT_FAB-Smart_Dashed_lines.gh (Grasshopper 0.9.75)

# ----
# Unit:
list = ValueList({"mm": 1, "cm": 10, "m": 1000}, selected="mm")

# ----
# Crv input
crv = Curve(<curve referenced from the Rhino model>)

bounds_dash = BooleanToggle(False)

# ----
# Unit:
list_2 = ValueList({"mm": 1, "cm": 10, "m": 1000}, selected="cm")

dash_step_mm = Slider(2, range=1..12)

# ----
# Crv input
crv_2 = Curve([<curve referenced from the Rhino model> x2])

cluster = Cluster(crv=crv_2, P=bounds_dash, B=list_2, B_2=dash_step_mm)
crv_3 = Curve(cluster)

crv_4 = Curve(graft(crv))

end = EndPoints(Curve=crv_4)  # -> Start, End
len = Length(Curve=crv_4)
multiplication = Multiplication(A=len, B=list)

# ----
# Crv output
bounds_dash_2 = BooleanToggle(False)
dash_step_mm_2 = Slider(12, range=1..12)

integer_division = IntegerDivision(A=multiplication, B=dash_step_mm_2)
panel = Panel(integer_division)

# ----
# Identify even number
panel_2 = Panel("2")
mod = Modulus(A=integer_division, B=panel_2)
smaller = SmallerThan(FirstNumber=mod, SecondNumber="0")  # -> SmallerThan, OrEqualTo

# ----
# If even
panel_3 = Panel("1")
addition = Addition(A=integer_division, B=panel_3)

weave = Weave(Pattern=smaller.OrEqualTo, Stream0=integer_division, Stream1=addition, NullGaps=False)
divide = DivideCurve(Curve=crv_4, Count=weave, Kinks=False)  # -> Points, Tangents, Parameters
shatter = Shatter(Curve=crv_4, Parameters=divide.Parameters)

panel_4 = Panel("""1
0""")
panel_5 = Panel("""0
1""")
cull = CullPattern(List=shatter, CullPattern=panel_5)
cull_2 = CullPattern(List=shatter, CullPattern=panel_4)

weave_2 = Weave(Pattern=bounds_dash_2, Stream0=cull, Stream1=cull_2, NullGaps=False)
crv_5 = Curve(weave_2)

crv_6 = Curve(crv_5)

# ==== cluster Cluster
crv = ClusterInput()

crv_2 = Curve(graft(crv))

B = ClusterInput()
end = EndPoints(Curve=crv_2)  # -> Start, End
len = Length(Curve=crv_2)
B_2 = ClusterInput()
multiplication = Multiplication(A=len, B=B)
integer_division = IntegerDivision(A=multiplication, B=B_2)
panel = Panel(integer_division)

# ----
# Identify even number
panel_2 = Panel("2")
mod = Modulus(A=integer_division, B=panel_2)
smaller = SmallerThan(FirstNumber=mod, SecondNumber="0")  # -> SmallerThan, OrEqualTo

# ----
# If even
panel_3 = Panel("1")
addition = Addition(A=integer_division, B=panel_3)

weave = Weave(Pattern=smaller.OrEqualTo, Stream0=integer_division, Stream1=addition, NullGaps=False)
divide = DivideCurve(Curve=crv_2, Count=weave, Kinks=False)  # -> Points, Tangents, Parameters
shatter = Shatter(Curve=crv_2, Parameters=divide.Parameters)

panel_4 = Panel("""1
0""")
panel_5 = Panel("""0
1""")
cull = CullPattern(List=shatter, CullPattern=panel_5)
cull_2 = CullPattern(List=shatter, CullPattern=panel_4)

P = ClusterInput()
weave_2 = Weave(Pattern=P, Stream0=cull, Stream1=cull_2, NullGaps=False)
crv_3 = Curve(weave_2)
crv_4 = ClusterOutput(crv_3)
