# Grasshopper definition DLNT_FAB-Snaking.gh (Grasshopper 0.9.76)
# Copyright: CC-BY-NC

crv = Curve([<curve referenced from the Rhino model> x50])
end = EndPoints(Curve=crv)  # -> Start, End
pdecon = Deconstruct(Point=end.Start)  # -> XComponent, YComponent, ZComponent
sort = SortList(Keys=pdecon.XComponent, ValuesA=crv)  # -> Keys, ValuesA
dispatch = Dispatch(List=sort.ValuesA, DispatchPattern=[True, False])  # -> ListA, ListB
crv_2 = Curve(dispatch.ListB)
crv_3 = Curve(dispatch.ListA)
flip = FlipCurve(Curve=crv_2)  # -> Curve, Flag
end_2 = EndPoints(Curve=crv_3)  # -> Start, End
end_3 = EndPoints(Curve=flip.Curve)  # -> Start, End
ln = Line(StartPoint=end_2.Start, EndPoint=end_3.End)
merge = Merge(Data1=crv_3, Data2=ln, Data3=flip.Curve)
join = JoinCurves(Curves=merge, Preserve=False)
end_4 = EndPoints(Curve=join)  # -> Start, End
shift = ShiftList(List=join, Shift=1, Wrap=True)
cull_last = CULL_last(L=shift)
pt = Point(end_4.Start)
end_5 = EndPoints(Curve=cull_last)  # -> Start, End
ln_2 = Line(StartPoint=end_4.Start, EndPoint=end_5.End)
merge_2 = Merge(Data1=join, Data2=ln_2)  # -> flatten(Result)
join_2 = JoinCurves(Curves=merge_2, Preserve=False)
fillet = Fillet(Curve=join_2, Radius=Slider(2, range=0..10))
division = Division(A=Slider(4, range=0..10), B=2)
neg = Negative(Value=division)
offset = Offset(Curve=fillet, Distance=neg, Plane=PlaneXY(0, 0, 0), Corners=1)
offset_2 = Offset(Curve=fillet, Distance=division, Plane=PlaneXY(0, 0, 0), Corners=1)
preview = CustomPreview(Geometry=[offset_2, offset], Shader=ColourSwatch(SwatchColor=RGB(255, 255, 255)))

# ==== cluster CULL_last
L = ClusterInput()
lng = ListLength(List=L)
subtraction = Subtraction(A=lng, B=1)
cull_i = CullIndex(List=L, Indices=subtraction, Wrap=True)
L_2 = ClusterOutput(cull_i)
