# Grasshopper definition DLNT-Arc_2pt-r.gh (Grasshopper 0.9.75)

A = StartPoint()
B = EndPoint()
flip = Flip()
radius = Radius()
bool = Boolean(flip)
r = Number(radius)
ln = Line(StartPoint=A, EndPoint=B)
eval = EvaluateCurve(Curve=ln, Parameter=0.5)  # -> Point, Tangent, Angle
end = EndPoints(Curve=ln)  # -> Start, End
vec2pt = Vector2Pt(PointA=end.Start, PointB=end.End, Unitize=False)  # -> Vector, Length
Z = UnitZ(Factor=eval.Tangent)
xprod = CrossProduct(VectorA=vec2pt.Vector, VectorB=Z, Unitize=False)  # -> Vector, Length
neg = Negative(Value=xprod.Vector)
multiplication = Multiplication(A=r, B=2)
flip_arc = BooleanToggle(False)
weave = Weave(Pattern=bool, Stream0=xprod.Vector, Stream1=neg, NullGaps=False)
line = LineSDL(Start=eval.Point, Direction=weave, Length=multiplication)
cluster = Cluster(flip=flip_arc)  # -> arc, center
eval_2 = EvaluateCurve(Curve=line, Parameter=0.5)  # -> Point, Tangent, Angle
circle = Circle3Pt(PointA=end.Start, PointB=end.End, PointC=eval_2.Point)  # -> Circle, Plane, Radius
crv_cp = CurveClosestPoint(Point=end.Start, Curve=reparameterize(circle.Circle))  # -> Point, Parameter, Distance
crv_cp_2 = CurveClosestPoint(Point=end.End, Curve=reparameterize(circle.Circle))  # -> Point, Parameter, Distance
dom = ConstructDomain(DomainStart=crv_cp.Parameter, DomainEnd=crv_cp_2.Parameter)
subcrv = SubCurve(BaseCurve=reparameterize(circle.Circle), Domain=dom)
crv = Curve(subcrv)
arc = Arc(crv)
center = Center(eval_2.Point)

# ==== cluster Cluster
A = ClusterInput()
B = ClusterInput()
flip = ClusterInput()
radius = ClusterInput()
bool = Boolean(flip)
r = Number(radius)
ln = Line(StartPoint=A, EndPoint=B)
eval = EvaluateCurve(Curve=ln, Parameter=0.5)  # -> Point, Tangent, Angle
end = EndPoints(Curve=ln)  # -> Start, End
vec2pt = Vector2Pt(PointA=end.Start, PointB=end.End, Unitize=False)  # -> Vector, Length
Z = UnitZ(Factor=eval.Tangent)
xprod = CrossProduct(VectorA=vec2pt.Vector, VectorB=Z, Unitize=False)  # -> Vector, Length
neg = Negative(Value=xprod.Vector)
multiplication = Multiplication(A=r, B=2)
weave = Weave(Pattern=bool, Stream0=xprod.Vector, Stream1=neg, NullGaps=False)
line = LineSDL(Start=eval.Point, Direction=weave, Length=multiplication)
eval_2 = EvaluateCurve(Curve=line, Parameter=0.5)  # -> Point, Tangent, Angle
circle = Circle3Pt(PointA=end.Start, PointB=end.End, PointC=eval_2.Point)  # -> Circle, Plane, Radius
crv_cp = CurveClosestPoint(Point=end.Start, Curve=reparameterize(circle.Circle))  # -> Point, Parameter, Distance
crv_cp_2 = CurveClosestPoint(Point=end.End, Curve=reparameterize(circle.Circle))  # -> Point, Parameter, Distance
dom = ConstructDomain(DomainStart=crv_cp.Parameter, DomainEnd=crv_cp_2.Parameter)
subcrv = SubCurve(BaseCurve=reparameterize(circle.Circle), Domain=dom)
crv = Curve(subcrv)
arc = ClusterOutput(crv)
center = ClusterOutput(eval_2.Point)
