# Grasshopper definition DLNT-Crv_Boolean.gh (Grasshopper 0.9.76)
# Copyright: CC-BY-NC

crv = Curve([<curve referenced from the Rhino model> x4725])
join = JoinCurves(Curves=flatten(crv), Preserve=False)
cls = Closed(Curve=join)  # -> Closed, Periodic
cull = CullPattern(List=join, CullPattern=invert(cls.Periodic))
xy = XYPlane(Origin=Point(0, 0, 0))
project = Project(Geometry=cull, Plane=xy)  # -> Geometry, Transform
runion = RegionUnion(Curves=project.Geometry, Plane=xy)  # disabled
