# Grasshopper definition DLNT-Crv_Normal_t.gh (Grasshopper 0.9.75)

C = Curve()
t = Parameter()
eval = EvaluateCurve(Curve=C, Parameter=t)  # -> Point, Tangent, Angle
end = EndPoints(Curve=C)  # -> Start, End
vec2pt = Vector2Pt(PointA=end.Start, PointB=end.End, Unitize=False)  # -> Vector, Length
Z = UnitZ(Factor=eval.Tangent)
crv_normal = Crv_Normal()  # -> pt_2, V
xprod = CrossProduct(VectorA=vec2pt.Vector, VectorB=Z, Unitize=False)  # -> Vector, Length
pt = Point(eval.Point)
pt_2 = Point(pt)
V = Vector(xprod.Vector)

# ==== cluster Crv_Normal
C = ClusterInput()
t = ClusterInput()
eval = EvaluateCurve(Curve=C, Parameter=t)  # -> Point, Tangent, Angle
end = EndPoints(Curve=C)  # -> Start, End
vec2pt = Vector2Pt(PointA=end.Start, PointB=end.End, Unitize=False)  # -> Vector, Length
Z = UnitZ(Factor=eval.Tangent)
xprod = CrossProduct(VectorA=vec2pt.Vector, VectorB=Z, Unitize=False)  # -> Vector, Length
pt = Point(eval.Point)
pt_2 = ClusterOutput(pt)
V = ClusterOutput(xprod.Vector)
