# Grasshopper definition DLNT-Offset_crv-Both_sides_cap.gh (Grasshopper 0.9.76)
# Copyright: CC-BY-NC

C = Curve()
D = Distance()
number_slider = Slider(1, range=0..4)
offset_crv_both_sides_cap = Offset_crvBoth_sidesCap()
neg = Negative(Value=D)
offset = Offset(Curve=C, Distance=D, Plane=PlaneXY(0, 0, 0), Corners=number_slider)
offset_2 = Offset(Curve=C, Distance=neg, Plane=PlaneXY(0, 0, 0), Corners=number_slider)
end = EndPoints(Curve=offset)  # -> Start, End
end_2 = EndPoints(Curve=offset_2)  # -> Start, End
ln = Line(StartPoint=end.Start, EndPoint=end_2.Start)
ln_2 = Line(StartPoint=end.End, EndPoint=end_2.End)
merge = Merge(Data1=ln, Data2=offset_2, Data3=ln_2, Data4=offset)
join = JoinCurves(Curves=merge, Preserve=False)
C_2 = Curves(join)

# ==== cluster Offset_crvBoth_sidesCap
C = ClusterInput()
D = ClusterInput()
number_slider = Slider(1, range=0..4)
neg = Negative(Value=D)
offset = Offset(Curve=C, Distance=D, Plane=PlaneXY(0, 0, 0), Corners=number_slider)
offset_2 = Offset(Curve=C, Distance=neg, Plane=PlaneXY(0, 0, 0), Corners=number_slider)
end = EndPoints(Curve=offset)  # -> Start, End
end_2 = EndPoints(Curve=offset_2)  # -> Start, End
ln = Line(StartPoint=end.Start, EndPoint=end_2.Start)
ln_2 = Line(StartPoint=end.End, EndPoint=end_2.End)
merge = Merge(Data1=ln, Data2=offset_2, Data3=ln_2, Data4=offset)
join = JoinCurves(Curves=merge, Preserve=False)
C_2 = ClusterOutput(join)
