# Grasshopper definition DLNT-Offset_crv_both_side.gh (Grasshopper 0.9.76)
# Copyright: CC-BY-NC

# Offset crv both side
C = Curve()
distance = Distance()
offset_both_side = OffsetBothSide()  # -> C_2, C_3
neg = Negative(Value=distance)
offset = Offset(Curve=C, Distance=distance, Plane=PlaneXY(0, 0, 0), Corners=1)
offset_2 = Offset(Curve=C, Distance=neg, Plane=PlaneXY(0, 0, 0), Corners=1)
C_2 = Curve(offset)
C_3 = C(offset_2)

# ==== cluster OffsetBothSide
C = ClusterInput()
distance = ClusterInput()
neg = Negative(Value=distance)
offset = Offset(Curve=C, Distance=distance, Plane=PlaneXY(0, 0, 0), Corners=1)
offset_2 = Offset(Curve=C, Distance=neg, Plane=PlaneXY(0, 0, 0), Corners=1)
C_2 = ClusterOutput(offset)
C_3 = ClusterOutput(offset_2)
