# Grasshopper definition DLNT-Shuffle_Sfr_sizes.gh (Grasshopper 0.9.76)
# Copyright: CC-BY-NC

# ---- group: Ref. Pt altitude
pt = Point(<point referenced from the Rhino model>)

# ---- group: Srf to shuffle
srf = Surface([<surface referenced from the Rhino model> x39])

# ----
xy = XYPlane(Origin=pt)
lng = ListLength(List=srf)
dom = ConstructDomain(DomainStart=Slider(0.6, range=0..1), DomainEnd=Slider(1.3, range=0..10))
sec = BrepPlane(Brep=srf, Plane=xy)  # -> Curves, Points
random = Random(Range=dom, Number=lng, Seed=Slider(999, range=0..1000))  # -> simplify(Random)
curvepoint = PointOnCurve(sec.Curves, parameter=0.5)
scale = Scale(Geometry=simplify(graft(srf)), Center=simplify(curvepoint), Factor=simplify(graft(random)))  # -> Geometry, Transform

# ---- group: To bake
srf_2 = Surface(scale.Geometry)
