# Grasshopper definition DLNT-Cull_first&last.gh (Grasshopper 0.9.75)

# ----
# Cull first
L = List()
cull_i = CullIndex(List=L, Indices=0, Wrap=True)
L_2 = List(cull_i)

# ----
# Cull first and last
L_3 = List()
lng = ListLength(List=L_3)
subtraction = Subtraction(A=lng, B=1)
merge = Merge(Data1="0", Data2=subtraction)  # -> flatten(Result)
cull_i_2 = CullIndex(List=L_3, Indices=merge, Wrap=True)
L_4 = List(cull_i_2)

# ----
# Cull last
L_5 = List()
lng_2 = ListLength(List=L_5)
subtraction_2 = Subtraction(A=lng_2, B=1)
cull_i_3 = CullIndex(List=L_5, Indices=subtraction_2, Wrap=True)
L_6 = List(cull_i_3)

cull_first = CULL_first()
cull_last = CULL_last()
cull_first_last = CULLFirstLast()

# ==== cluster CULLFirstLast
L = ClusterInput()
lng = ListLength(List=L)
subtraction = Subtraction(A=lng, B=1)
merge = Merge(Data1="0", Data2=subtraction)  # -> flatten(Result)
cull_i = CullIndex(List=L, Indices=merge, Wrap=True)
L_2 = ClusterOutput(cull_i)

# ==== cluster CULL_last
L = ClusterInput()
lng = ListLength(List=L)
subtraction = Subtraction(A=lng, B=1)
cull_i = CullIndex(List=L, Indices=subtraction, Wrap=True)
L_2 = ClusterOutput(cull_i)

# ==== cluster CULL_first
L = ClusterInput()
cull_i = CullIndex(List=L, Indices=0, Wrap=True)
L_2 = ClusterOutput(cull_i)
