# Grasshopper definition DLNT-List_first&last.gh (Grasshopper 0.9.75)

# ----
# Cfirst
L = List()
item = ListItem(List=L, Index=0, Wrap=True)
i = Item(item)

# ----
# List first and last
L_2 = List()
lng = ListLength(List=L_2)
subtraction = Subtraction(A=lng, B=1)
merge = Merge(Data1="0", Data2=subtraction)  # -> flatten(Result)
item_2 = ListItem(List=L_2, Index=merge, Wrap=True)
i_2 = Item(item_2)

# ----
# List last
L_3 = List()
lng_2 = ListLength(List=L_3)
subtraction_2 = Subtraction(A=lng_2, B=1)
item_3 = ListItem(List=L_3, Index=subtraction_2, Wrap=True)
i_3 = Item(item_3)

list_first = ListFirst()
list_last = ListLast()
list_f_l = List_FL()

# ==== cluster ListFirst
L = ClusterInput()
item = ListItem(List=L, Index=0, Wrap=True)
i = ClusterOutput(item)

# ==== cluster ListLast
L = ClusterInput()
lng = ListLength(List=L)
subtraction = Subtraction(A=lng, B=1)
item = ListItem(List=L, Index=subtraction, Wrap=True)
i = ClusterOutput(item)

# ==== cluster List_FL
L = ClusterInput()
lng = ListLength(List=L)
subtraction = Subtraction(A=lng, B=1)
merge = Merge(Data1="0", Data2=subtraction)  # -> flatten(Result)
item = ListItem(List=L, Index=merge, Wrap=True)
i = ClusterOutput(item)
