# Grasshopper definition DLNT-Serie_mapped0to1.gh (Grasshopper 0.9.76)
# Copyright: CC-BY-NC

count = Count()
division = Division(A=1, B=count)
_1_nb_serie = _1NbSerie()
series = Series(Start=0, Step=division, Count=expr("x+1", count))
S = Series(series)

# ==== cluster _1NbSerie
count = ClusterInput()
division = Division(A=1, B=count)
series = Series(Start=0, Step=division, Count=expr("x+1", count))
S = ClusterOutput(series)
