# Grasshopper definition DLNT_Polygon-srf_attractor.gh (Grasshopper 0.9.75)

density_u = Slider(35, range=10..150)
density_v = Slider(60, range=10..300)
margins_edges = Slider(4, range=0..10)
density_u_2 = Slider(31, range=10..150)
density_v_2 = Slider(83, range=10..300)
margins_edges_2 = Slider(4, range=0..10)
# Top
srf = Surface(<surface referenced from the Rhino model>)
# face
srf_2 = Surface(<surface referenced from the Rhino model>)
pt = Point(<point referenced from the Rhino model>)
pt_2 = Point(<point referenced from the Rhino model>)
division = Division(A=density_v, B=density_u)
# Actual coeff
panel = Panel(division)
division_2 = Division(A=density_v_2, B=density_u_2)
panel_2 = Panel(division_2)
srf_3 = Surface(srf)
srf_4 = Surface(srf_2)
edges = BrepEdges(Brep=srf_3)  # -> Naked, Interior, NonManifold
edges_2 = BrepEdges(Brep=srf_4)  # -> Naked, Interior, NonManifold
join = JoinCurves(Curves=edges.Naked, Preserve=False)
join_2 = JoinCurves(Curves=edges_2.Naked, Preserve=False)
offsets = OffsetOnSrf(Curve=join, Distance=margins_edges, Surface=srf_3)
offsets_2 = OffsetOnSrf(Curve=join_2, Distance=margins_edges_2, Surface=srf_4)
srfsplit = SurfaceSplit(Surface=srf_3, Curves=offsets)
srfsplit_2 = SurfaceSplit(Surface=srf_4, Curves=offsets_2)
item = ListItem(List=srfsplit, Index=0, Wrap=True)  # -> Item, Item1
item_2 = ListItem(List=srfsplit_2, Index=0, Wrap=True)  # -> Item, Item1

U = Integer(density_u)
V = Integer(density_v)

U_2 = Integer(density_u_2)
V_2 = Integer(density_v_2)

sdivide = DivideSurface(Surface=item.Item1, UCount=U, VCount=V)  # -> simplify(Points), simplify(Normals), simplify(Parameters)
sdivide_2 = DivideSurface(Surface=item_2.Item1, UCount=U_2, VCount=V_2)  # -> simplify(Points), simplify(Normals), simplify(Parameters)
evalsrf = EvaluateSurface(Surface=simplify(srf_3), Point=simplify(sdivide.Parameters))  # -> Point, Normal, Frame
evalsrf_2 = EvaluateSurface(Surface=simplify(srf_4), Point=simplify(sdivide_2.Parameters))  # -> Point, Normal, Frame
dist = Distance(PointA=pt, PointB=flatten(evalsrf.Point))
pl = PlaneNormal(Origin=evalsrf.Point, ZAxis=evalsrf.Normal)
dist_2 = Distance(PointA=pt_2, PointB=flatten(evalsrf_2.Point))
pl_2 = PlaneNormal(Origin=evalsrf_2.Point, ZAxis=evalsrf_2.Normal)

null = NullItem(Item=evalsrf.Point)  # -> NullFlags, InvalidFlags, Description
cull = CullPattern(List=evalsrf.Point, CullPattern=invert(null.NullFlags))
prox = Proximity3D(Points=flatten(cull), Group=5, MaxRadius=Slider(6, range=0..10))  # -> flatten(Links), Topology

null_2 = NullItem(Item=evalsrf_2.Point)  # -> NullFlags, InvalidFlags, Description
cull_2 = CullPattern(List=evalsrf_2.Point, CullPattern=invert(null_2.NullFlags))
prox_2 = Proximity3D(Points=flatten(cull_2), Group=5, MaxRadius=Slider(6, range=0..10))  # -> flatten(Links), Topology

bnd = Bounds(Numbers=flatten(dist))
bnd_2 = Bounds(Numbers=flatten(dist_2))
remap = RemapNumbers(Value=dist, Source=bnd, Target=Domain(0, 1))  # -> Mapped, Clipped

graph = GraphMapper(
    remap.Mapped,
    x0=0,
    x1=1,
    y0=0,
    y1=1,
    container_name="Gaussian",
    factor=0.1636232734,
    mean=0.007428608369,
    sdev=0.2803809722)
dom = ConstructDomain(DomainStart=Slider(0.5, range=0..1), DomainEnd=Slider(3, range=0..5))

remap_2 = RemapNumbers(Value=dist_2, Source=bnd_2, Target=Domain(0, 1))  # -> Mapped, Clipped

# ----
# Polygon controls
number_slider = Slider(0.5, range=0..1)
graph_2 = GraphMapper(
    remap_2.Mapped,
    x0=0,
    x1=1,
    y0=0,
    y1=1,
    container_name="Gaussian",
    factor=0.4375469685,
    mean=0.007428608369,
    sdev=0.2452164968)
dom_2 = ConstructDomain(DomainStart=number_slider, DomainEnd=Slider(3, range=0..5))

cluster = Cluster(P=pl, S=Slider(4, range=0..10), num=graph, T=dom)
cluster_2 = Cluster(P=pl_2, S=Slider(4, range=0..10), num=graph_2, T=dom_2)
null_3 = NullItem(Item=cluster)  # -> NullFlags, InvalidFlags, Description
null_4 = NullItem(Item=cluster_2)  # -> NullFlags, InvalidFlags, Description
cull_3 = CullPattern(List=cluster, CullPattern=invert(null_3.NullFlags))
cull_4 = CullPattern(List=cluster_2, CullPattern=invert(null_4.NullFlags))
crv = Curve(cull_3)
crv_2 = Curve(cull_4)
pull = PullCurve(Curve=crv, Surface=srf)  # disabled
pull_2 = PullCurve(Curve=crv_2, Surface=srf_2)

# ==== cluster Cluster
num = ClusterInput()
num_2 = Number(num)
T = ClusterInput()
bnd = Bounds(Numbers=flatten(num_2))
remap = RemapNumbers(Value=num_2, Source=bnd, Target=T)  # -> Mapped, Clipped
division = Division(A=remap.Mapped, B=2)
P = ClusterInput()
S = ClusterInput()
polygon = Polygon(Plane=flatten(P), Radius=division, Segments=S, FilletRadius=0)  # -> Polygon, Length
P_2 = ClusterOutput(polygon.Polygon)
