# Grasshopper definition DLNT_TrimPattern.gh (Grasshopper 0.9.75)

crv = Curve(<curve referenced from the Rhino model>)
crv_2 = Curve([<curve referenced from the Rhino model> x1500])
crv_3 = Curve([<curve referenced from the Rhino model> x1500])
crv_4 = Curve([<curve referenced from the Rhino model> x1500])
Z = UnitZ(Factor=1)
neg = Negative(Value=Z)
flatten = FlattenTree(Tree=crv_3, Path="{0}")
move = Move(Geometry=crv, Motion=Z)  # -> Geometry, Transform
move_2 = Move(Geometry=crv, Motion=neg)  # -> Geometry, Transform
join = JoinCurves(Curves=flatten, Preserve=False)
loft = Loft(
    Curves=[move.Geometry, move_2.Geometry],
    Options={Adjust=False, Closed=False, LoftEnds=0, LoftSimp=0, LoftType=0, Rebuild=10, Refit=0.01})
cap = CapHoles(Brep=loft)
trim = TrimWithBrep(Curve=join, Brep=cap)  # -> Inside, Outside
crv_5 = Curve(trim.Inside)
