# Grasshopper definition DLNT_Viz-GlassPanels_AngleVariations.gh (Grasshopper 0.9.76)
# Copyright: CC-BY-NC

srf = Surface(graft([<surface referenced from the Rhino model> x12]))
geo = Geometry([<brep referenced from the Rhino model> x37, <curve referenced from the Rhino model> x37, <brep referenced from the Rhino model> x37, <curve referenced from the Rhino model> x37])
area = Area(Geometry=srf)  # -> Area, Centroid
lng = ListLength(List=srf)

rot_z = Slider(0.5, range=0..3)
neg = Negative(Value=rot_z)
dom = ConstructDomain(DomainStart=rot_z, DomainEnd=neg)
random = Random(Range=dom, Number=lng, Seed=Slider(999, range=0..1000))
rad = Radians(Degrees=random)

rot_x = Slider(0.1, range=0..3)
neg_2 = Negative(Value=rot_x)
dom_2 = ConstructDomain(DomainStart=rot_x, DomainEnd=neg_2)
random_2 = Random(Range=dom_2, Number=lng, Seed=Slider(999, range=0..1000))
rad_2 = Radians(Degrees=random_2)

rot_y = Slider(0, range=0..3)
neg_3 = Negative(Value=rot_y)
dom_3 = ConstructDomain(DomainStart=rot_y, DomainEnd=neg_3)
random_3 = Random(Range=dom_3, Number=lng, Seed=Slider(999, range=0..1000))
rad_3 = Radians(Degrees=random_3)

volume = Volume(Geometry=geo)  # -> Volume, Centroid
lng_2 = ListLength(List=geo)

rot_z_2 = Slider(0.5, range=0..3)
neg_4 = Negative(Value=rot_z_2)
dom_4 = ConstructDomain(DomainStart=rot_z_2, DomainEnd=neg_4)
random_4 = Random(Range=dom_4, Number=lng_2, Seed=Slider(999, range=0..1000))
rad_4 = Radians(Degrees=random_4)

rot_x_2 = Slider(0.1, range=0..3)
neg_5 = Negative(Value=rot_x_2)
dom_5 = ConstructDomain(DomainStart=rot_x_2, DomainEnd=neg_5)
random_5 = Random(Range=dom_5, Number=lng_2, Seed=Slider(999, range=0..1000))
rad_5 = Radians(Degrees=random_5)

rot_y_2 = Slider(0, range=0..3)
neg_6 = Negative(Value=rot_y_2)
dom_6 = ConstructDomain(DomainStart=rot_y_2, DomainEnd=neg_6)
random_6 = Random(Range=dom_6, Number=lng_2, Seed=Slider(999, range=0..1000))
rad_6 = Radians(Degrees=random_6)

panel = Panel(volume.Centroid)
Y = UnitY(Factor=1)
X = UnitX(Factor=1)
Z = UnitZ(Factor=1)
rot3d = Rotate3D(Geometry=srf, Angle=rad_2, Center=area.Centroid, Axis=X)  # -> Geometry, Transform
rot3d_2 = Rotate3D(Geometry=rot3d.Geometry, Angle=rad_3, Center=area.Centroid, Axis=Y)  # -> Geometry, Transform
rot3d_3 = Rotate3D(Geometry=rot3d_2.Geometry, Angle=rad, Center=area.Centroid, Axis=Z)  # -> Geometry, Transform
Y_2 = UnitY(Factor=1)
X_2 = UnitX(Factor=1)
Z_2 = UnitZ(Factor=1)
rot3d_4 = Rotate3D(Geometry=geo, Angle=rad_5, Center=volume.Centroid, Axis=X_2)  # -> Geometry, Transform
rot3d_5 = Rotate3D(Geometry=rot3d_4.Geometry, Angle=rad_6, Center=volume.Centroid, Axis=Y_2)  # -> Geometry, Transform
rot3d_6 = Rotate3D(Geometry=rot3d_5.Geometry, Angle=rad_4, Center=volume.Centroid, Axis=Z_2)  # -> Geometry, Transform
geo_2 = Geometry(rot3d_6.Geometry)
panel_2 = Panel(geo_2)
srf_2 = Surface(rot3d_3.Geometry)
panel_3 = Panel(srf_2)
